# Dynamo graph F0-01-CreateLevelsFromXLS.dyn "F0-01 TWÓRZ POZIOMY" (Dynamo 2.10.1.3976)

# group: INPUTS
# note: INPUTS

# group: DESIGN<DESCRPTION>
# note: DESIGN <DESCRIPTION>

# group: IMPORT
# note: IMPORT FILES

# group: PYTHON<DESCRPTION>
# note: PYTHON <DESCRIPTION>

# group: SET<DESCRPTION>
# note: SET <DESCRIPTION>

python_boilerplate = Python()  # IronPython2; frozen; unwired: IN[0]
# ---------- python_boilerplate.python (39 lines) ----------
import clr
import sys
sys.path.append('C:\Program Files (x86)\IronPython 2.7\Lib')
import System
from System import Array
from System.Collections.Generic import *
clr.AddReference('ProtoGeometry')
from Autodesk.DesignScript.Geometry import *
clr.AddReference("RevitNodes")
import Revit
clr.ImportExtensions(Revit.Elements)
clr.ImportExtensions(Revit.GeometryConversion)
clr.AddReference("RevitServices")
import RevitServices
from RevitServices.Persistence import DocumentManager 
from RevitServices.Transactions import TransactionManager 
clr.AddReference("RevitAPI")
clr.AddReference("RevitAPIUI")
import Autodesk 
from Autodesk.Revit.DB import *
from Autodesk.Revit.UI import *
####### Definitions ########
def internal_to_cm(value):
    return UnitUtils.ConvertFromInternalUnits(value, UnitTypeId.Centimeters)

def cm_to_internal(value):
    return UnitUtils.ConvertToInternalUnits(value, UnitTypeId.Centimeters)
    
#######Inputs########

#######CODE########
doc = DocumentManager.Instance.CurrentDBDocument
uiapp = DocumentManager.Instance.CurrentUIApplication 
app = uiapp.Application 
uidoc = uiapp.ActiveUIDocument

output = []
#######OUT########
OUT = output
# ----------------------------------------

# group: IMPORT CSV
# note: AUTHOR: PAWEŁ DREIER©
lokalizacja_pliku_csv_z = Filename(".\F0-01 LISTA POZIOMÓW.csv")  # "LOKALIZACJA PLIKU CSV Z KONDYGNACJAMI / POZIOMAMI"; graph input

# group: DESIGN <LevelsFromXls>
importCSV = Data.ImportCSV(filePath=lokalizacja_pliku_csv_z)
deconstruct = List.Deconstruct(list=importCSV@@L2)
transpose = List.Transpose(lists=deconstruct.rest)
deconstruct_2 = List.Deconstruct(list=transpose@L2)

flatten = List.Flatten(list=deconstruct_2.rest)

# group: Set<LevelsByElevation>
levelsByElevation = Python(IN[0]=deconstruct_2.first, IN[1]=flatten)  # IronPython2
# ---------- levelsByElevation.python (71 lines) ----------
import clr
import sys

sys.path.append('C:\Program Files (x86)\IronPython 2.7\Lib')
import System
from System import Array
from System.Collections.Generic import *

clr.AddReference('ProtoGeometry')
from Autodesk.DesignScript.Geometry import *

clr.AddReference("RevitNodes")
import Revit

clr.ImportExtensions(Revit.Elements)
clr.ImportExtensions(Revit.GeometryConversion)
clr.AddReference("RevitServices")
import RevitServices
from RevitServices.Persistence import DocumentManager
from RevitServices.Transactions import TransactionManager

clr.AddReference("RevitAPI")
clr.AddReference("RevitAPIUI")
import Autodesk
from Autodesk.Revit.DB import *
from Autodesk.Revit.UI import *


# --- Definitions
def internal_to_cm(value):
    return UnitUtils.ConvertFromInternalUnits(value, UnitTypeId.Centimeters)


def cm_to_internal(value):
    return UnitUtils.ConvertToInternalUnits(value, UnitTypeId.Centimeters)


# --- Inputs

# List of level names
level_names_lst = IN[0]
# List of elevations values
elevation_values_lst = IN[1]

# --- CODE
doc = DocumentManager.Instance.CurrentDBDocument
uiapp = DocumentManager.Instance.CurrentUIApplication
app = uiapp.Application
uidoc = uiapp.ActiveUIDocument

# Create a unified name length
str_level_names_lst = []

for level_name in level_names_lst:
    level_name = str(level_name)
    if len(level_name) == 1:
        level_name = "0" + level_name
    str_level_names_lst.append(level_name)

# Create Levels from elevation list
output = []

for level_name, level_elevation in zip(str_level_names_lst, elevation_values_lst):
    TransactionManager.Instance.EnsureInTransaction(doc)
    new_level = Level.Create(doc, cm_to_internal(int(level_elevation)))
    new_level.Name = level_name
    TransactionManager.Instance.TransactionTaskDone()
    output.append(new_level)

# --- OUT
OUT = output
# ----------------------------------------
